# Grasshopper definition Phi Table.gh (Grasshopper 0.9.76)

num_points = Slider(258, range=0..1000)
cull_points = Slider(102, range=0..200)

# ----
# Assumptions
# 
# Angle Measured : Radians
# Distance : Imperial (Inches)
inner_diameter = Slider(3.2, range=0..10)

diameter = Slider(6, range=0..10)

diameter_offset = Slider(0.28, range=0..1)
lip_offset = Slider(0.125, range=0..1)
phi_dot_radius = Slider(0.05, range=0..1)

# ---- group: Theta
pi = Pi(Factor=1)
multiplication = Multiplication(A=pi, B=2)

# ----
xy = XYPlane(Origin=Point(0, 0, 0))

# ---- group: PHI
phi = GoldenRatio(Factor=1)

# ---- group: Radius
division = Division(A=diameter, B=2)

# ----
neg = Negative(Value=lip_offset)

# ---- group: Radius
division_2 = Division(A=inner_diameter, B=2)

# ----
subtraction = Subtraction(A=num_points, B=cull_points)
subtraction_2 = Subtraction(A=division, B=diameter_offset)

# ---- group: Series Count
series = Series(Start=cull_points, Step=1, Count=subtraction)

# ----
division_3 = Division(A=subtraction_2, B=num_points)
multiplication_2 = Multiplication(A=phi, B=multiplication)
sqrt = SquareRoot(Value=series)
sqrt_2 = SquareRoot(Value=num_points)
multiplication_3 = Multiplication(A=sqrt, B=sqrt_2)
multiplication_4 = Multiplication(A=multiplication_2, B=series)
multiplication_5 = Multiplication(A=division_3, B=multiplication_3)
pt = ConstructPoint(XCoordinate=0, YCoordinate=multiplication_5, ZCoordinate=0)
pt_2 = ConstructPoint(XCoordinate=0, YCoordinate=0, ZCoordinate=0)

# ---- group: PHI Points
rotate = Rotate(Geometry=pt, Angle=multiplication_4, Plane=xy)  # -> Geometry, Transform

# ----
circle = CircleCNR(Center=pt_2, Normal=Vector(0, 0, 1), Radius=division)
circle_2 = CircleCNR(Center=pt_2, Normal=Vector(0, 0, 1), Radius=division_2)
circle_3 = CircleCNR(Center=rotate.Geometry, Normal=Vector(0, 0, 1), Radius=phi_dot_radius)
offset = Offset(Curve=circle_2, Distance=neg, Plane=xy, Corners=1)
offset_2 = Offset(Curve=circle, Distance=neg, Plane=xy, Corners=1)
